# Grasshopper definition Parametrics_FA21_ArPrivacyScreensDemo_20211025.gh (Grasshopper 1.0.7)

crv = Curve([<curve referenced from the Rhino model> x3])
loft = Loft(Curves=crv, Options={Adjust=False, Closed=False, LoftEnds=0, LoftSimp=0, LoftType=0, Rebuild=10, Refit=0.01})
divide = DivideDomain²(Domain=loft, UCount=Slider(7, range=5..25), VCount=Slider(13, range=5..25))
md_slider = MDSlider(
    SliderMode=0,
    slider_value=Point(0.5649952888, 0.6737470627, 0.5),
    x_domain=Domain(0, 1),
    y_domain=Domain(0, 1),
    z_domain=Domain(0, 1))
md_slider_2 = MDSlider(
    SliderMode=0,
    slider_value=Point(0.3894495964, 0.3964309692, 0.5),
    x_domain=Domain(0, 1),
    y_domain=Domain(0, 1),
    z_domain=Domain(0, 1))
subsrf = Isotrim(Surface=loft, Domain=divide)
debrep = DeconstructBrep(Brep=subsrf)  # -> Faces, Edges, Vertices
item = ListItem(List=debrep.Vertices, Index=0, Wrap=True)  # -> Item, Item1, Item2, Item3
evalsrf = EvaluateSurface(Surface=reparameterize(loft), Point=[md_slider_2, md_slider])  # -> Point, Normal, UDirection, VDirection, Frame
pt = Point(flatten(item.Item2))
pt_2 = Point(item.Item)
pull = PullPoint(Point=pt, Geometry=evalsrf.Point, ClosestOnly=True)  # -> ClosestPoint, Distance
srf_cp = SurfaceClosestPoint(Point=pt_2, Surface=loft)  # -> Point, UVPoint, Distance
srf_cp_2 = SurfaceClosestPoint(Point=pt, Surface=loft)  # -> Point, UVPoint, Distance
evalsrf_2 = EvaluateSurface(Surface=loft, Point=srf_cp.UVPoint)  # -> Point, Normal, UDirection, VDirection, Frame
evalsrf_3 = EvaluateSurface(Surface=loft, Point=srf_cp_2.UVPoint)  # -> Point, Normal, UDirection, VDirection, Frame
bnd = Bounds(Numbers=pull.Distance)
dom = ConstructDomain(DomainStart=Slider(0.194, range=0..1), DomainEnd=Slider(0.008, range=0..1))
amp = Amplitude(Vector=evalsrf_2.Normal, Amplitude=Slider(0, range=0..1))
remap = RemapNumbers(Value=pull.Distance, Source=bnd, Target=dom)  # -> Mapped, Clipped
move = Move(Geometry=pt_2, Motion=amp)  # -> Geometry, Transform
amp_2 = Amplitude(Vector=evalsrf_3.Normal, Amplitude=remap.Mapped)
rev = Reverse(Vector=amp_2)
move_2 = Move(Geometry=pt, Motion=amp_2)  # -> graft(Geometry), Transform
ln = Line(StartPoint=move.Geometry, EndPoint=item.Item1)
ln_2 = Line(StartPoint=item.Item3, EndPoint=move_2.Geometry)
merge = Merge(Data1=ln, Data2=ln_2)
loft_2 = Loft(Curves=merge, Options={Adjust=False, Closed=False, LoftEnds=0, LoftSimp=0, LoftType=0, Rebuild=10, Refit=0.01})
