# Grasshopper definition Parametrics_FA21_ArPrivacyScreensDemo_20211101.gh (Grasshopper 1.0.7)
# plug-ins: ShapeDiverForGrasshopper, BitmapComponent, GrasshopperHyperGooComponents, Weaverbird

sddb = ShapeDiverDatabase({AbsoluteTolerance=0.001, AngleTolerance=1, AppDescription="", AppName="Parametrics_FA21_ArPrivacyScreensDemo_20211025*", DocumentName="Parametrics_FA21_ArPrivacyScreensDemo_20211025*", InputGroups="{\"686047c2-2567-4155-a897-fee878b4b926\":{\"name\":\"SDInput\",\"guid\":\"686047c2-2567-4155-a897-fee878b4b926\",\"index\":0,\"params\":[\"06351790-cd64-459f-9381-c9fd7de619e6\"],\"indexFloor\":0,\"indexCeiling\":0}}", OutputGroups="{}", RelativeTolerance=0.01, UnitSystem=4})
crv = Curve([<curve referenced from the Rhino model> x3])
loft = Loft(Curves=crv, Options={Adjust=False, Closed=False, LoftEnds=0, LoftSimp=0, LoftType=0, Rebuild=10, Refit=0.01})
divide = DivideDomain²(Domain=loft, UCount=Slider(7, range=5..25), VCount=Slider(11, range=5..25))
md_slider = MDSlider(
    SliderMode=0,
    slider_value=Point(0.5649952888, 0.6737470627, 0.5),
    x_domain=Domain(0, 1),
    y_domain=Domain(0, 1),
    z_domain=Domain(0, 1))
md_slider_2 = MDSlider(
    SliderMode=0,
    slider_value=Point(0.3894495964, 0.3964309692, 0.5),
    x_domain=Domain(0, 1),
    y_domain=Domain(0, 1),
    z_domain=Domain(0, 1))
subsrf = Isotrim(Surface=loft, Domain=divide)
debrep = DeconstructBrep(Brep=subsrf)  # -> Faces, Edges, Vertices
item = ListItem(List=debrep.Vertices, Index=0, Wrap=True)  # -> Item, Item1, Item2, Item3
evalsrf = EvaluateSurface(Surface=reparameterize(loft), Point=[md_slider_2, md_slider])  # -> Point, Normal, UDirection, VDirection, Frame
pt = Point(flatten(item.Item2))
pt_2 = Point(item.Item)
pull = PullPoint(Point=pt, Geometry=evalsrf.Point, ClosestOnly=True)  # -> ClosestPoint, Distance
srf_cp = SurfaceClosestPoint(Point=pt_2, Surface=loft)  # -> Point, UVPoint, Distance
srf_cp_2 = SurfaceClosestPoint(Point=pt, Surface=loft)  # -> Point, UVPoint, Distance
evalsrf_2 = EvaluateSurface(Surface=loft, Point=srf_cp.UVPoint)  # -> Point, Normal, UDirection, VDirection, Frame
evalsrf_3 = EvaluateSurface(Surface=loft, Point=srf_cp_2.UVPoint)  # -> Point, Normal, UDirection, VDirection, Frame
bnd = Bounds(Numbers=pull.Distance)
dom = ConstructDomain(DomainStart=Slider(0.143, range=0..1), DomainEnd=Slider(0, range=0..1))
amp = Amplitude(Vector=evalsrf_2.Normal, Amplitude=Slider(0, range=0..1))
remap = RemapNumbers(Value=pull.Distance, Source=bnd, Target=dom)  # -> Mapped, Clipped
move = Move(Geometry=pt_2, Motion=amp)  # -> Geometry, Transform
amp_2 = Amplitude(Vector=evalsrf_3.Normal, Amplitude=remap.Mapped)
rev = Reverse(Vector=amp_2)
move_2 = Move(Geometry=pt, Motion=amp_2)  # -> graft(Geometry), Transform
ln = Line(StartPoint=move.Geometry, EndPoint=item.Item1)
ln_2 = Line(StartPoint=item.Item3, EndPoint=move_2.Geometry)
number_slider = Slider(1, range=0..1)
merge = Merge(Data1=ln, Data2=ln_2)
bmp_wood_pattern = Bitmap(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)
bmp_levelsets = Bitmap(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)
bmp_tile_weave = Bitmap(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)
bmp_tile_water = Bitmap(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)
bmp_tile_rings = Bitmap(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)
bmp_tile_aqua = Bitmap(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)
bmp_tile_disks = Bitmap(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)
loft_2 = Loft(Curves=merge, Options={Adjust=False, Closed=False, LoftEnds=0, LoftSimp=0, LoftType=0, Rebuild=10, Refit=0.01})  # -> flatten(Loft)
mesh_uv = MeshSurface(Surface=reparameterize(loft_2), UCount=number_slider, VCount=number_slider, Overhang=True, Equalize=False)
evalsrf_4 = EvaluateSurface(Surface=reparameterize(loft_2), Point="0.5, 0.5")  # -> Point, Normal, UDirection, VDirection, Frame
advancedmaterial = AdvancedMaterial(Color=ColourSwatch(SwatchColor=RGB(255, 141, 182)), FlatShading=False)
dom_2 = ConstructDomain(DomainStart=0, DomainEnd=1)
wbthicken = WeaverbirdsMeshThicken(MeshCurves=graft(mesh_uv), Distance=Slider(0.001, range=0..0.001), OffsetType=0)  # -> flatten(OutputMeshCurves)
panel = Panel(loft_2)
orientsplit = SplitByOrientation(Geometry=wbthicken, Plane=evalsrf_4.Point, Dx=dom_2, Dy=dom_2, AngleTol=0, MeshYN=False)  # -> Top, Bottom, Back, Front, Right, Left, Planar, flatten(Unplanar)
exsdmaterial = ExplodeShapeDiverMaterial(Material=advancedmaterial)  # -> Color, ColorMap, Metalness, MetalnessMap, Roughness, RoughnessMap, Opacity, OpacityMap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
constructattr = ConstructAttributes(Keys="material", Values=graft(advancedmaterial))  # -> flatten(Attributes)
panel_2 = Panel(exsdmaterial.Color)
srf = Surface(<surface referenced from the Rhino model>)
panel_3 = Panel("Wall to 0,0 transform")
srf_2 = Surface(<surface referenced from the Rhino model>)
panel_4 = Panel(advancedmaterial)
evalsrf_5 = EvaluateSurface(Surface=reparameterize(srf_2), Point="0.5, 0.5")  # -> Point, Normal, UDirection, VDirection, Frame
evalsrf_6 = EvaluateSurface(Surface=reparameterize(srf), Point="0.5, 0.5")  # -> Point, Normal, UDirection, VDirection, Frame
pln = Plane(evalsrf_5.Frame)
pln_2 = Plane(evalsrf_6.Frame)
injectattr = InjectAttributes(Object=wbthicken, Attributes=constructattr)
orient = Orient(Geometry=wbthicken, Source=pln, Target=pln_2)  # -> Geometry, Transform
mesh = Mesh(orient.Geometry)
mesh_2 = Mesh(injectattr)
path = FilePath("C:\Users\epoulsen\Documents\TEMP\shapediver-export.glb")

# ---- group: Use this component to preview the mesh textures
sdinput = ShapeDiverInput(In4=mesh_2, ParameterSchemas="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")

# ----
update_this_path = Panel("C:\Users\spitf\OneDrive\Desktop\Parametrics_Fall2021\screen002.glb")
gltfexport = GlTF20Exporter(Data=mesh)
button = Button()
panel_5 = Panel(button)
toggle = BooleanToggle(False)
# https://gltf-viewer.donmccurdy.com/
c_script = CSharpScript(input=gltfexport, path=update_this_path, trigger=button)  # -> out, A; inputs path: String, trigger: Boolean
# ---------- c_script: C# ----------
    if(trigger){
      try {
        System.IO.Stream stream = input as System.IO.Stream;
        using (var fileStream = System.IO.File.Create(path))
        {
          stream.Seek(0, System.IO.SeekOrigin.Begin);
          stream.CopyTo(fileStream);
          A = "File saved successfully.";
        }
      }
      catch(Exception e){
        A = "An error occurred";
        throw e;
      }
    } else {
      A = "Nothing saved. Set the trigger to 'True' to save files.";
    }
# ---------- end c_script ----------
status = Panel(c_script.A)
