# Grasshopper definition Parametrics_FA21_ArPrivacyScreensDemo_20211108.gh (Grasshopper 1.0.7)
# plug-ins: Weaverbird

crv = Curve([<curve referenced from the Rhino model> x3])
loft = Loft(Curves=crv, Options={Adjust=False, Closed=False, LoftEnds=0, LoftSimp=0, LoftType=0, Rebuild=10, Refit=0.01})
divide = DivideDomain²(Domain=loft, UCount=Slider(10, range=5..25), VCount=Slider(19, range=5..25))
md_slider = MDSlider(SliderMode=0, slider_value=Point(0, 0, 0.5), x_domain=Domain(0, 1), y_domain=Domain(0, 1), z_domain=Domain(0, 1))
md_slider_2 = MDSlider(SliderMode=0, slider_value=Point(1, 1, 0.5), x_domain=Domain(0, 1), y_domain=Domain(0, 1), z_domain=Domain(0, 1))
subsrf = Isotrim(Surface=loft, Domain=divide)
debrep = DeconstructBrep(Brep=subsrf)  # -> Faces, Edges, Vertices
item = ListItem(List=debrep.Vertices, Index=0, Wrap=True)  # -> Item, Item1, Item2, Item3
evalsrf = EvaluateSurface(Surface=reparameterize(loft), Point=[md_slider_2, md_slider])  # -> Point, Normal, UDirection, VDirection, Frame
pt = Point(flatten(item.Item2))
pt_2 = Point(item.Item)
srf_cp = SurfaceClosestPoint(Point=pt_2, Surface=loft)  # -> Point, UVPoint, Distance
pull = PullPoint(Point=pt, Geometry=evalsrf.Point, ClosestOnly=True)  # -> ClosestPoint, Distance
srf_cp_2 = SurfaceClosestPoint(Point=pt, Surface=loft)  # -> Point, UVPoint, Distance
evalsrf_2 = EvaluateSurface(Surface=loft, Point=srf_cp.UVPoint)  # -> Point, Normal, UDirection, VDirection, Frame
evalsrf_3 = EvaluateSurface(Surface=loft, Point=srf_cp_2.UVPoint)  # -> Point, Normal, UDirection, VDirection, Frame
bnd = Bounds(Numbers=pull.Distance)
dom = ConstructDomain(DomainStart=Slider(0.149, range=0..1), DomainEnd=Slider(0, range=0..1))
amp = Amplitude(Vector=evalsrf_2.Normal, Amplitude=Slider(0, range=0..1))
remap = RemapNumbers(Value=pull.Distance, Source=bnd, Target=dom)  # -> Mapped, Clipped
move = Move(Geometry=pt_2, Motion=amp)  # -> Geometry, Transform
amp_2 = Amplitude(Vector=evalsrf_3.Normal, Amplitude=remap.Mapped)
rev = Reverse(Vector=amp_2)
move_2 = Move(Geometry=pt, Motion=rev)  # -> graft(Geometry), Transform
ln = Line(StartPoint=move.Geometry, EndPoint=item.Item1)
ln_2 = Line(StartPoint=item.Item3, EndPoint=move_2.Geometry)
number_slider = Slider(1, range=0..1)
merge = Merge(Data1=ln, Data2=ln_2)
loft_2 = Loft(Curves=merge, Options={Adjust=False, Closed=False, LoftEnds=0, LoftSimp=0, LoftType=0, Rebuild=10, Refit=0.01})  # -> flatten(Loft)
mesh_uv = MeshSurface(Surface=reparameterize(loft_2), UCount=number_slider, VCount=number_slider, Overhang=True, Equalize=False)
evalsrf_4 = EvaluateSurface(Surface=reparameterize(loft_2), Point="0.5, 0.5")  # -> Point, Normal, UDirection, VDirection, Frame
wbthicken = WeaverbirdsMeshThicken(MeshCurves=graft(mesh_uv), Distance=Slider(0.001, range=0..0.001), OffsetType=0)  # -> flatten(OutputMeshCurves)
bbox = BoundingBox(Content=wbthicken, Plane=PlaneXY(0, 0, 0))  # -> Box, Box_2
bbox_2 = BoundingBox(Content=wbthicken, Plane=PlaneXY(0, 0, 0))  # -> Box, Box_2
volume = Volume(Geometry=bbox.Box)  # -> Volume, Centroid
volume_2 = Volume(Geometry=bbox_2.Box)  # -> Volume, Centroid
pdecon = Deconstruct(Point=volume.Centroid)  # -> XComponent, YComponent, ZComponent
dom_2 = ConstructDomain(DomainStart=Slider(-0.48, range=-1..1), DomainEnd=Slider(0.26, range=-1..1))
pdecon_2 = Deconstruct(Point=volume_2.Centroid)  # -> XComponent, YComponent, ZComponent
# remap-based gradient material example
addition = Addition(A=pdecon.XComponent, B=pdecon.ZComponent)
bnd_2 = Bounds(Numbers=pdecon_2.ZComponent)
bnd_3 = Bounds(Numbers=addition)
remap_2 = RemapNumbers(Value=pdecon_2.ZComponent, Source=bnd_2, Target=Domain(0, 1))  # -> Mapped, Clipped
lng = ListLength(List=remap_2.Mapped)
remap_3 = RemapNumbers(Value=addition, Source=bnd_3, Target=Domain(0, 1))  # -> Mapped, Clipped
random = Random(Range=dom_2, Number=lng, Seed=2)
gradient = Gradient(LowerLimit=0, UpperLimit=1, Parameter=remap_3.Mapped, stops=[0: RGB(255, 255, 255), 1: RGB(0, 0, 0)])
addition_2 = Addition(A=random, B=Slider(0.56, range=0.25..0.75))
smaller = SmallerThan(FirstNumber=remap_2.Mapped, SecondNumber=addition_2)  # -> SmallerThan, OrEqualTo
panel = Panel(addition_2)
# dispatch-based two tone material example
dispatch = Dispatch(List=wbthicken, DispatchPattern=smaller.SmallerThan)  # -> ListA, ListB
preview = CustomPreview(Geometry=wbthicken, Material=gradient)
preview_2 = CustomPreview(Geometry=dispatch.ListA, Material=ColourSwatch(SwatchColor=RGB(255, 255, 255)))
preview_3 = CustomPreview(Geometry=dispatch.ListB, Material=ColourSwatch(SwatchColor=RGB(0, 0, 0)))
