# Grasshopper definition Parametrics_FA21_ArPrivacyScreensDemo_20211114.gh (Grasshopper 1.0.7)
# plug-ins: ShapeDiverForGrasshopper, GrasshopperHyperGooComponents, Weaverbird, Human, BitmapComponent

sddb = ShapeDiverDatabase({AbsoluteTolerance=0.001, AngleTolerance=1, AppDescription="", AppName="Parametrics_FA21_ArPrivacyScreensDemo_20211025*", DocumentName="Parametrics_FA21_ArPrivacyScreensDemo_20211025*", InputGroups="{\"164aa572-da35-488a-80ec-ed14e7c85878\":{\"name\":\"SDInput\",\"guid\":\"164aa572-da35-488a-80ec-ed14e7c85878\",\"index\":0,\"params\":[\"ea71f66d-149a-461a-9965-242fac1f9d5f\"],\"indexFloor\":0,\"indexCeiling\":0}}", OutputGroups="{}", RelativeTolerance=0.01, UnitSystem=4})
crv = Curve([<curve referenced from the Rhino model> x3])
loft = Loft(Curves=crv, Options={Adjust=False, Closed=False, LoftEnds=0, LoftSimp=0, LoftType=0, Rebuild=10, Refit=0.01})
divide = DivideDomain²(Domain=loft, UCount=Slider(7, range=5..25), VCount=Slider(11, range=5..25))
md_slider = MDSlider(
    SliderMode=0,
    slider_value=Point(0.5649952888, 0.6737470627, 0.5),
    x_domain=Domain(0, 1),
    y_domain=Domain(0, 1),
    z_domain=Domain(0, 1))
md_slider_2 = MDSlider(
    SliderMode=0,
    slider_value=Point(0.3894495964, 0.3964309692, 0.5),
    x_domain=Domain(0, 1),
    y_domain=Domain(0, 1),
    z_domain=Domain(0, 1))
subsrf = Isotrim(Surface=loft, Domain=divide)
debrep = DeconstructBrep(Brep=subsrf)  # -> Faces, Edges, Vertices
item = ListItem(List=debrep.Vertices, Index=0, Wrap=True)  # -> Item, Item1, Item2, Item3
evalsrf = EvaluateSurface(Surface=reparameterize(loft), Point=[md_slider_2, md_slider])  # -> Point, Normal, UDirection, VDirection, Frame
pt = Point(flatten(item.Item2))
pt_2 = Point(item.Item)
pull = PullPoint(Point=pt, Geometry=evalsrf.Point, ClosestOnly=True)  # -> ClosestPoint, Distance
srf_cp = SurfaceClosestPoint(Point=pt_2, Surface=loft)  # -> Point, UVPoint, Distance
srf_cp_2 = SurfaceClosestPoint(Point=pt, Surface=loft)  # -> Point, UVPoint, Distance
evalsrf_2 = EvaluateSurface(Surface=loft, Point=srf_cp.UVPoint)  # -> Point, Normal, UDirection, VDirection, Frame
evalsrf_3 = EvaluateSurface(Surface=loft, Point=srf_cp_2.UVPoint)  # -> Point, Normal, UDirection, VDirection, Frame
bnd = Bounds(Numbers=pull.Distance)
dom = ConstructDomain(DomainStart=Slider(0.143, range=0..1), DomainEnd=Slider(0, range=0..1))
amp = Amplitude(Vector=evalsrf_2.Normal, Amplitude=Slider(0, range=0..1))
remap = RemapNumbers(Value=pull.Distance, Source=bnd, Target=dom)  # -> Mapped, Clipped
move = Move(Geometry=pt_2, Motion=amp)  # -> Geometry, Transform
amp_2 = Amplitude(Vector=evalsrf_3.Normal, Amplitude=remap.Mapped)
rev = Reverse(Vector=amp_2)
move_2 = Move(Geometry=pt, Motion=amp_2)  # -> graft(Geometry), Transform
ln = Line(StartPoint=move.Geometry, EndPoint=item.Item1)
ln_2 = Line(StartPoint=item.Item3, EndPoint=move_2.Geometry)
number_slider = Slider(1, range=0..1)
merge = Merge(Data1=ln, Data2=ln_2)
bmp = Bitmap(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)
swatch = ColourSwatch(SwatchColor=RGB(255, 141, 182))
loft_2 = Loft(Curves=merge, Options={Adjust=False, Closed=False, LoftEnds=0, LoftSimp=0, LoftType=0, Rebuild=10, Refit=0.01})  # -> flatten(Loft)
mesh_uv = MeshSurface(Surface=reparameterize(loft_2), UCount=number_slider, VCount=number_slider, Overhang=True, Equalize=False)
advancedmaterial = AdvancedMaterial(Color=RGB(255, 255, 255), ColorMap=bmp, Opacity=Slider(0.86, range=0..1), FlatShading=Toggle(True))
wbthicken = WeaverbirdsMeshThicken(MeshCurves=graft(mesh_uv), Distance=Slider(0.001, range=0..0.001), OffsetType=0)  # -> flatten(OutputMeshCurves)
surfacemap = SurfaceMapping(Mesh=wbthicken, Surface=reparameterize(loft_2))
constructattr = ConstructAttributes(Keys="material", Values=graft(advancedmaterial))  # -> flatten(Attributes)
injectattr = InjectAttributes(Object=surfacemap, Attributes=constructattr)
mesh = Mesh(injectattr)
sdinput = ShapeDiverInput(In0=mesh, ParameterSchemas="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")
panel = Panel("Wall to 0,0 transform")
srf = Surface(<surface referenced from the Rhino model>)
srf_2 = Surface(<surface referenced from the Rhino model>)
evalsrf_4 = EvaluateSurface(Surface=reparameterize(srf), Point="0.5, 0.5")  # -> Point, Normal, UDirection, VDirection, Frame
evalsrf_5 = EvaluateSurface(Surface=reparameterize(srf_2), Point="0.5, 0.5")  # -> Point, Normal, UDirection, VDirection, Frame
pln = Plane(evalsrf_4.Frame)
pln_2 = Plane(evalsrf_5.Frame)
orient = Orient(Geometry=surfacemap, Source=pln, Target=pln_2)  # -> Geometry, Transform
injectattr_2 = InjectAttributes(Object=orient.Geometry, Attributes=constructattr)
mesh_2 = Mesh(injectattr_2)
update_this_path = Panel("C:\Users\spitf\OneDrive\Desktop\Parametrics_Fall2021\screen003.glb")
button = Button()
gltfexport = GlTF20Exporter(Data=mesh_2)
toggle = BooleanToggle(False)
panel_2 = Panel(button)
c_script = CSharpScript(input=gltfexport, path=update_this_path, trigger=button)  # -> out, A; inputs path: String, trigger: Boolean
# ---------- c_script: C# ----------
    if(trigger){
      try {
        System.IO.Stream stream = input as System.IO.Stream;
        using (var fileStream = System.IO.File.Create(path))
        {
          stream.Seek(0, System.IO.SeekOrigin.Begin);
          stream.CopyTo(fileStream);
          A = "File saved successfully.";
        }
      }
      catch(Exception e){
        A = "An error occurred";
        throw e;
      }
    } else {
      A = "Nothing saved. Set the trigger to 'True' to save files.";
    }
# ---------- end c_script ----------
status = Panel(c_script.A)
